# Grasshopper definition Visualize Marker Transformation.gh (Grasshopper 1.0.7)

# ----
# Reload Python Modules (if Module Code is Changed)
python_module_to_reload = Panel("""compas
compas_fab
roslibpy
integral_timber_joints""")
# Development Tools
reload = Button()
py = PythonScript(reload_module_button=reload, module_names=python_module_to_reload)  # inputs module_names: list
# ---------- py: Python ----------
import compas_ghpython
from compas_ghpython import unload_modules
if reload_module_button:
    for module in module_names:
        unload_modules(module)
# ---------- end py ----------

panel = Panel("3. Load from ROS")

# ----
# Check Path and Environment
compas_version = GhPythonScript()  # -> out, compas_version, compas_fab_version, compas_path, compas_fab_path, compas_env_name, python_directory
# ---------- compas_version: Python ----------
__author__ = "leungp"
__version__ = "2020.04.20"

import rhinoscriptsyntax as rs
import compas
import compas_fab
compas_version  = compas.__version__
compas_fab_version = compas_fab.__version__
import os
compas_path = os.path.abspath(compas.__file__)
compas_fab_path = os.path.abspath(compas_fab.__file__)

import compas_bootstrapper
compas_env_name = compas_bootstrapper.ENVIRONMENT_NAME
python_directory = compas_bootstrapper.PYTHON_DIRECTORY
# ---------- end compas_version ----------
compas_environment_name = Panel(compas_version.compas_env_name)
compas_version_2 = Panel(compas_version.compas_version)
compas_fab_version = Panel(compas_version.compas_fab_version)
compas_path = Panel(compas_version.compas_path)
compas_fab_path = Panel(compas_version.compas_fab_path)
python_directory = Panel(compas_version.python_directory)

restart = Button()
ros = PythonScript(ip="192.168.1.4", restart=restart)  # -> out, ros_client, is_connected
# ---------- ros: Python ----------
import sys
import time
import logging
import scriptcontext as sc

from compas_fab.backends import RosClient

from System import TimeSpan
from System.Threading import ManualResetEventSlim

LOGGER = logging.getLogger('roslibpy')

key = 'rosclient_%s' % str(ghenv.Component.InstanceGuid)
previous_client = sc.sticky.get(key, None)
if previous_client:
    previous_client.terminate()

ros_client = RosClient(ip, 9090)
sc.sticky[key] = ros_client

waitLock = ManualResetEventSlim(False)

ros_client.on_ready(lambda: waitLock.Set())

if not waitLock.Wait(TimeSpan.FromSeconds(5)):
    raise Exception('Unable to connect to ROS')

LOGGER.info('ROS connection opened')


is_connected = ros_client.is_connected
# ---------- end ros ----------

# ---- group: Setup Callback for Topic
load = Button()
python = PythonScript(client=ros.ros_client, load=load)  # -> robot; inputs load: Boolean
# ---------- python: Python ----------
from scriptcontext import sticky as st
import json
import compas
from compas.robots import RobotModel
from compas.geometry import Transformation
from compas_fab.backends import RosClient
from compas_fab.backends import RosFileServerLoader
from compas_fab.ghpython import RobotArtist
from roslibpy import Topic
# Set high precision to import meshes defined in meters
compas.PRECISION = '24f'

# store robot in component
guid = str(ghenv.Component.InstanceGuid)
topic_key = "topic_" + guid

if topic_key not in st:
    st[topic_key] = None

if client and client.is_connected and load:
    st['camera_frame'] = None
    def read_frame(msg):
        st['camera_frame'] = Transformation.from_data(json.loads(msg['data']))
        
    topic = Topic(client, '/camera_frames', 'std_msgs/String')
    topic.subscribe(read_frame)
    st[topic_key] = topic

topic = st[topic_key]
# ---------- end python ----------

# ----
is_connected = Panel(ros.is_connected)
timer = Timer(TimerInterval=50, Target=python_2)  # disabled
load_2 = Button()
python_2 = GhPythonScript(y=load_2)  # -> out, compas_frame, rhino_plane
# ---------- python_2: Python ----------
from scriptcontext import sticky as st
from compas.geometry import Frame
import Rhino.Geometry as rg

print(st['camera_frame'])

if st['camera_frame']:
    T = st['camera_frame']
    compas_frame = Frame.from_transformation(T.inverse())
    point = list(compas_frame.point)
    xaxis = list(compas_frame.xaxis)
    yaxis = list(compas_frame.yaxis)
    rhino_plane = rg.Plane(rg.Point3d(*point), rg.Vector3d(*xaxis), rg.Vector3d(*yaxis))
# ---------- end python_2 ----------
rec = DataRecorder(python_2.rhino_plane, DataLimit=1, RecordData=False)
dam = DataDam(DataA=python_2.rhino_plane, BufferDelay=10000000, BufferMode=0)

# ---- group: Visualization of Geometry
geo = Geometry([<brep referenced from the Rhino model> x3])
orient = Orient(Geometry=graft(geo), Source=dam, Target=python_2.rhino_plane)  # -> Geometry, Transform

# ---- group: Big arrows visualization
number_slider = Slider(1, range=0..1)
draw = GhPythonScript(frames=python_2.compas_frame, scale=Slider(23, range=0..1000))  # -> P, V, C, W, flatten(planes); inputs frames: list
# ---------- draw: Python ----------
from System.Drawing import Color
from compas_ghpython import draw_frame

red = Color.FromArgb(255, 0, 0)
green = Color.FromArgb(0, 255, 0)
blue = Color.FromArgb(0, 0, 255)

P = []
V = []
C = []
planes = []

scale = float(scale)

for frame in frames:
    if not frame:
        continue
    plane = draw_frame(frame)
    P += [plane.Origin] * 3
    V.append(plane.XAxis * scale)
    V.append(plane.YAxis * scale)
    V.append(plane.ZAxis * scale)
    C += [red, green, blue]
    planes.append(plane)

W = 3
# ---------- end draw ----------
scale = Scale(Geometry=draw.P, Center=Point(0, 0, 0), Factor=1000)  # -> Geometry, Transform
vector_display_ex = VectorDisplayEx(Point=draw.P, Vector=draw.V, Colour=draw.C, Width=draw.W)

# ----
rec_2 = DataRecorder(python_2.rhino_plane, DataLimit=10, RecordData=True)
pdecon = Deconstruct(Point=rec_2)  # -> XComponent, YComponent, ZComponent
sort = SortList(Keys=pdecon.XComponent)  # -> Keys, ValuesA
sort_2 = SortList(Keys=pdecon.YComponent)  # -> Keys, ValuesA
sort_3 = SortList(Keys=pdecon.ZComponent)  # -> Keys, ValuesA
item = ListItem(List=sort.Keys, Index=0, Wrap=True)  # -> Item1, Item
item_2 = ListItem(List=sort_2.Keys, Index=0, Wrap=True)  # -> Item1, Item
item_3 = ListItem(List=sort_3.Keys, Index=0, Wrap=True)  # -> Item1, Item
subtraction = Subtraction(A=item.Item1, B=item.Item)
subtraction_2 = Subtraction(A=item_2.Item1, B=item_2.Item)
subtraction_3 = Subtraction(A=item_3.Item1, B=item_3.Item)
dam_2 = DataDam(DataA=python_2.rhino_plane, BufferDelay=10000000, BufferMode=0)
abs = Absolute(Value=subtraction)
abs_2 = Absolute(Value=subtraction_2)
abs_3 = Absolute(Value=subtraction_3)
dam_3 = DataDam(DataA=python_2.rhino_plane, BufferDelay=10000000, BufferMode=0)
panel_2 = Panel([abs, abs_2, abs_3])
panel_3 = Panel(dam_2)
dist = Distance(PointA=dam_2, PointB=dam_3)
panel_4 = Panel(python_2.rhino_plane)
panel_5 = Panel(dist)
